# Dynamo graph auto-column-placement.dyn (Dynamo 2.18.1.5096)

family_types = FamilyTypes("Columns_Rectangular:600x600mm")
byPointAndLevel = FamilyInstance.ByPointAndLevel()  # unwired: familyType, point, level
levels = Levels("Level 0")
categories = Categories("OST_Grids")
all_elements_of_category = ElementsOfCategory(Category=categories)
