# Dynamo graph tower-mass.dyn (Dynamo 2.18.1.5096)

string = StringInput("height")
parameterByName = Parameter.ParameterByName(name=string)  # unwired: element
watch = Watch(parameterByName)
number = DoubleInput(20)
setValue = Parameter.SetValue(parameter=string, value=number)
watch_2 = Watch(setValue)
group_types = GroupTypes()  # nothing selected
